# Grasshopper definition Testfile.gh (Grasshopper 1.0.8)
# plug-ins: DataTreeExplorer Info

series = Series(Start=0, Step=1, Count=2)  # -> flatten(Series)
series_2 = Series(Start=series, Step=1, Count=10)
construct_point = ConstructPoint(XCoordinate=0, YCoordinate=0, ZCoordinate=0)
construct_point_2 = ConstructPoint(XCoordinate=series_2, YCoordinate=0, ZCoordinate=0)
series_3 = Series(Start=series, Step=1, Count=10)
line = Line(StartPoint=construct_point_2, EndPoint=construct_point)
line_2 = Line(graft(line))
merge = Merge(Data1=series, Data2=line, Data3=series_3, Data4=line_2)
tree_item = TreeItem(Index=0, Wrap=True)
data_tree_explorer = DataTreeExplorer()
param_viewer = ParamViewer()
param_viewer_2 = ParamViewer(merge)
explode_tree = ExplodeTree(Data=merge)  # -> Branch0, Branch1, Branch2, Branch3, Branch4
tree_statistics = TreeStatistics(Tree=merge)  # -> Paths, Length, Count
data_tree_explorer_2 = DataTreeExplorer(Tree=merge)  # -> Branch0, Branch00, Branch000, Branch001, Branch002, Branch003, Branch004, Branch005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
panel = Panel(data_tree_explorer_2.Branch01)
